# Grasshopper definition 20250530_ReadResults_withMultipliers.gh (Grasshopper 1.0.8)
# plug-ins: RhinoCodePluginGH, CORE.Toolbox.Grasshopper, LadybugGrasshopper

# ----
# 1a. SET SIMULATION FOLDER
# & BUILDING NAMES
path_to_simulation_folder_edit_as_req_d = Panel("C:\Simulations\test_results")
unique_bldg_ids_edit_as_req_d = Panel("""214127
214132
214137
82562""")

# ----
# 1b. RUN
falsestart = LBFalseStartToggle(True)

# ----
# 1. SET SIMULATION FOLDER AND ADD BUILDING IDs,
# THEN SET TOGGLE TO 'TRUE'
# (will take a long time if hundreds of buildings are read from .sql)
do_not_modify_this_panel = Panel("\run\honeybee_scenario\")
do_not_modify_this_panel_2 = Panel("\eplusout.sql")
concat = Concatenate(FragmentA=path_to_simulation_folder_edit_as_req_d, FragmentB=do_not_modify_this_panel)
concat_2 = Concatenate(FragmentA=concat, FragmentB=unique_bldg_ids_edit_as_req_d)
concat_3 = Concatenate(FragmentA=concat_2, FragmentB=do_not_modify_this_panel_2)
paths_where_results_will_be_read = Panel(concat_3)
gate = StreamGate(Stream=concat_3, Gate=falsestart)  # -> Target0, Target1

readtable = HBReadTabularData(sql=gate.Target1, table_name="EAp2-4/5. Performance Rating Method Compliance")  # -> simplify(values), simplify(col_names), simplify(row_names); plug-in component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
row_names = Panel(readtable.row_names)
column_names = Panel(readtable.col_names)
values_note_automatically_converted_from = Panel(readtable.values)  # "Values (NOTE: automatically converted from GJ to kWh)"
# Automatic retrieval of total values from EPlus Reports.
# Note that the Honeybee tools automatically convert GJ (as printed in the reports) to kWh (which are shown in the panel outputs).
lng = ListLength(List=readtable.col_names)
flatten = FlattenTree(Tree=lng, Path="{0}")

readtable_2 = HBReadTabularData(sql=gate.Target1, table_name="Zone Information")  # -> values, col_names, row_names; plug-in component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
column_names_2 = Panel(readtable_2.col_names)
values = Panel(readtable_2.values)
lng_2 = ListLength(List=readtable_2.col_names)
flatten_2 = FlattenTree(Tree=lng_2, Path="{0}")

# ----
# Automatic calculation of Zone Multipliers
# Note: 'heating', 'cooling', and 'hot_water' values do NOT require multipliers.
# BUT 'lighting' & 'electric_equip' need to be multiplied by the Zone Multiplier.
partition = PartitionList(List=readtable_2.values, Size=flatten_2)  # -> simplify(Chunks)
partitioned_lists = Panel(partition)
path_mapper = PathMapper(partition, source="{A;B}", target="{0;B}")
re_mapped_data_tree = Panel(path_mapper)
partition_2 = PartitionList(List=path_mapper, Size=flatten_2)
partitioned_by_building_id = Panel(partition_2)
x1_multiplier_for_htg_clg_dhw = Panel("1")
item = ListItem(List=partition_2, Index="9", Wrap=True)  # -> simplify(Item)
multiplier_for_lighting_electric_equip = Panel(item)

branch = TreeBranch(Tree=readtable.values, Path="{1}", MaintainPaths=True)
all_values_cooling = Panel(branch)
partition_3 = PartitionList(List=branch, Size=flatten)
partitioned_lists_cooling = Panel(partition_3)
item_2 = ListItem(List=partition_3, Index="20", Wrap=True)
final_values_cooling = Panel(item_2)

# ----
# Then, in Excel, compare 'CHECK' values from EPlus Reports to the sum of the time-series values.
# They should differ only by a small rounding error (due to converting GJ to kWh).
# 2a. SELECT
# ENERGY
# SERVICE
list = ValueList({"cooling", "heating", "lighting", "electric_equip", "hot_water"}, selected="lighting")

branch_2 = TreeBranch(Tree=readtable.values, Path="{0}", MaintainPaths=True)
all_values_heating = Panel(branch_2)
partition_4 = PartitionList(List=branch_2, Size=flatten)
partitioned_lists_heating = Panel(partition_4)
item_3 = ListItem(List=partition_4, Index="22", Wrap=True)
final_values_heating = Panel(item_3)

# ----
# Automatic multiplier selection
# (depending on energy service selected)
py3 = Python3Script(x=list)  # -> out, filter_out
# ---------- py3: Python ----------
"""Grasshopper Script"""

if x == 'cooling' or x == 'heating' or x == 'hot_water':
    filter_out = 0
elif x == 'lighting' or x == 'electric_equip':
    filter_out = 1
# ---------- end py3 ----------
filter = StreamFilter(Gate=py3.filter_out, Stream0=x1_multiplier_for_htg_clg_dhw, Stream1=item)
effective_multiplier_used = Panel(filter)

# ----
# Automatic extraction of .sql files
roomenergyresult = HBReadRoomEnergyResult(sql=gate.Target1)  # -> cooling, heating, lighting, electric_equip, gas_equip, process, hot_water, fan_electric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; plug-in component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
py3_2 = Python3Script(x=list)  # -> out, num_out
# ---------- py3_2: Python ----------
"""Grasshopper Script"""

if x == 'cooling':
    num_out = 0
elif x == 'heating':
    num_out = 1
elif x == 'lighting':
    num_out = 2
elif x == 'electric_equip':
    num_out = 3
elif x == 'hot_water':
    num_out = 4
# ---------- end py3_2 ----------
filter_2 = StreamFilter(
    Gate=py3_2.num_out,
    Stream0=roomenergyresult.cooling,
    Stream1=roomenergyresult.heating,
    Stream2=roomenergyresult.lighting,
    Stream3=roomenergyresult.electric_equip,
    Stream4=roomenergyresult.hot_water)
panel = Panel(filter_2)
xdata = LBDeconstructData(data=filter_2)  # -> flatten(header), values; plug-in component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
multiplication = Multiplication(A=xdata.values, B=filter)
values_before_multiplier = Panel(xdata.values)
values_after_multiplier = Panel(multiplication)

# ----
# 2b. RUN
falsestart_2 = LBFalseStartToggle(False)

branch_3 = TreeBranch(Tree=readtable.values, Path="{2}", MaintainPaths=True)
all_values_lighting = Panel(branch_3)
partition_5 = PartitionList(List=branch_3, Size=flatten)
partitioned_lists_lighting = Panel(partition_5)
item_4 = ListItem(List=partition_5, Index="0", Wrap=True)
final_values_lighting = Panel(item_4)

graft = GraftTree(Tree=unique_bldg_ids_edit_as_req_d, IncludeEmptyLists=True, IncludeNullItems=True)

branch_4 = TreeBranch(Tree=readtable.values, Path="{4}", MaintainPaths=True)
all_values_electric_equip = Panel(branch_4)
partition_6 = PartitionList(List=branch_4, Size=flatten)
partitioned_lists_electric_equip = Panel(partition_6)
item_5 = ListItem(List=partition_6, Index="0", Wrap=True)
final_values_electric_equip = Panel(item_5)

branch_5 = TreeBranch(Tree=readtable.values, Path="{11}", MaintainPaths=True)
all_values_hot_water = Panel(branch_5)
partition_7 = PartitionList(List=branch_5, Size=flatten)
partitioned_lists_hot_water = Panel(partition_7)
item_6 = ListItem(List=partition_7, Index="22", Wrap=True)
final_values_hot_water = Panel(item_6)

py3_3 = Python3Script(x=list)  # -> out, num_out; same code as py3_2
filter_3 = StreamFilter(Gate=py3_3.num_out, Stream0=item_2, Stream1=item_3, Stream2=item_4, Stream3=item_5, Stream4=item_6)
path_mapper_2 = PathMapper(filter_3, source="{A;B}", target="{0;B}")
values_for_selected_energy_service = Panel(path_mapper_2)

# ----
# 2. SET DESIRED ENERGY SERVICE,
# THEN SET TO 'TRUE' TO CREATE EXCEL FILE
# Adds final values from EPlus
# Reports to double check against
# time-series values
# Adds simulation time-series
# results to Excel file for
# selected energy service
# Adds labels for each building
# & zone to Excel file
# Py script to clean header
# from extraneous text
# Py script to delay pasting
# data after header
# Py scripts to delay pasting
# check data
py3_4 = Python3Script(energy_svc=list, text_in=xdata.header)  # -> out, line_out; inputs text_in: tree
# ---------- py3_4: Python ----------
"""Grasshopper Script"""
import ghpythonlib.treehelpers as th

text_lst = th.tree_to_list(text_in)

line_out_lst = []

if energy_svc == 'cooling' or energy_svc == 'heating':
    for line in text_lst:
        line = str(line)
        line = line.split('System: ')
        line = line[1]
        line = line.split('_ROOM1')
        line = line[0]
        line_out_lst.append(line)
elif energy_svc == 'lighting' or energy_svc == 'electric_equip':
    for line in text_lst:
        line = str(line)
        line = line.split('Zone: ')
        line = line[1]
        line = line.split('_ROOM1')
        line = line[0]
        line_out_lst.append(line)
elif energy_svc == 'hot_water':
    for line in text_lst:
        line = str(line)
        line = line.split('..')
        line = line[1]
        line = line.split('_')
        line = line[0]+'_'+line[1]
        line_out_lst.append(line)

line_out = th.list_to_tree(line_out_lst)
# ---------- end py3_4 ----------
graft_2 = GraftTree(Tree=py3_4.line_out, IncludeEmptyLists=True, IncludeNullItems=True)
cleaned_header_data_must_be_grafted = Panel(graft_2)
xl_out = WriteToExcelClassic(WorksheetName=list, Data=graft_2, LocationAddress="A1", Clear=0, Stream=falsestart_2)
py3_5 = Python3Script(x=falsestart_2)  # -> out, x
# ---------- py3_5: Python ----------
"""Grasshopper Script"""
import time
time.sleep(0.1)
# ---------- end py3_5 ----------
xl_out_2 = WriteToExcelClassic(WorksheetName=list, Data=multiplication, LocationAddress="B1", Clear=0, Stream=py3_5.x)
py3_6 = Python3Script(x=falsestart_2)  # -> out, x
# ---------- py3_6: Python ----------
"""Grasshopper Script"""
import time
time.sleep(0.5)
# ---------- end py3_6 ----------
concat_4 = Concatenate(FragmentA=list, FragmentB="_CHECK")
xl_out_3 = WriteToExcelClassic(WorksheetName=concat_4, Data=graft, LocationAddress="A1", Clear=0, Stream=py3_6.x)
py3_7 = Python3Script(x=py3_6.x)  # -> out, x; same code as py3_5
xl_out_4 = WriteToExcelClassic(WorksheetName=concat_4, Data=path_mapper_2, LocationAddress="B1", Clear=0, Stream=py3_7.x)
